# Grasshopper definition BOUNDARYgEN.gh (Grasshopper 0.9.76)

panel = Panel("""COMFORT ZONE
HEATING INTERNAL GAINS
PASSIVE SOLAR HEATING
ACTIVE SOLAR HEATING
HUMIDIFICATION
CONVENTIONAL HEATING
SOLAR PROTECTION
COOLING HIGH THERMAL MASS
EVAPORATIVE COOLING
COOLING HIGH THERMAL MASS WITH NIGHT COOLING
COOLING NATURAL AND MECHANICAL VENTILATION
AIR CONDITIONED
CONVENTIONAL DRY""")
number_slider = Slider(7, range=0..12)
crv = Curve([<curve referenced from the Rhino model> x13])
cpoly = ControlPolygon()  # -> Polygon, Points
cp = ControlPoints(Curve=crv)  # -> Points, Weights, Knots
item = ListItem(List=panel, Index=number_slider, Wrap=True)
item_2 = ListItem(List=crv, Index=number_slider, Wrap=True)
number_slider_2 = Slider(0.4, range=0..1)
area = Area(Geometry=item_2)  # -> Area, Centroid
c_script = CSharpScript(POINTS=cp.Points, name=panel)  # -> out, A; inputs POINTS: tree of Point3d, name: list of String
# ---------- c_script: C# ----------
    DataTree<Point3d> converted = new DataTree<Point3d>();
    StreamWriter sw = new StreamWriter(@"C:\Users\Admin\Documents\projects\clusterColombia\climacolombia\stategies\zones.txt");
    for(int i = 0;i < POINTS.BranchCount;i++)
    {
      String sb = name[i] + ",";
      for(int j = 0;j < POINTS.Branch(i).Count;j++)
      {
        double rh = relHumidfromHumidRatioTemp(POINTS.Branch(i)[j].X, POINTS.Branch(i)[j].Y / 1000, 88325);
        if(j != POINTS.Branch(i).Count - 1) sb += POINTS.Branch(i)[j].X + "," + rh + ",";
        else sb += POINTS.Branch(i)[j].X + "," + rh;
        converted.Add(new Point3d(POINTS.Branch(i)[j].X, rh, 0), new GH_Path(i));
      }
      sw.WriteLine(sb.ToString());
    }


    sw.Close();
    A = converted;
# ---------- c_script: C# additional code ----------
  private double relHumidfromHumidRatioTemp(double t, double hr, double atmosP){
    var partPress = partPressure(hr, atmosP);
    var satPress = saturationPress(t);
    var rh = relHumid(partPress, satPress);
    return rh;
  }
  private double antoniePartPress(double t){
    var T = t;
    var A = 8.07131;
    var B = 1730.63;
    var C = 233.426;
    var pp = Math.Pow(10, A - (B / (C + T)));
    return pp;//in pa
  }
  private double humidtyRatio(double atmosP, double pw){//pw is partial pressure of water vapour
    var w = (0.62198 * pw) / (atmosP - pw);
    return w;
  }
  private double partPressure(double humidtyRatio, double atmosP){
    var pp = ((atmosP * humidtyRatio) / (0.62198 + humidtyRatio));
    return pp;
  }
  private double relHumid(double partPress, double  saturationPress){
    //relhumid 0>1
    return partPress * 100 / saturationPress;

  }
  private double saturationPress(double temp) {
    //convert temp C to kelvin
    var kelvin = temp + 273.15;
    double[] c = new double[7];
    double pascals = 0.0;
    if(kelvin < 273.15){
      c[0] = -5674.5359;
      c[1] = 6.3925247;
      c[2] = -0.9677843 * Math.Pow(10, -2);
      c[3] = 0.62215701 * Math.Pow(10, -6);
      c[4] = 0.20747825 * Math.Pow(10, -8);
      c[5] = -0.9484024 * Math.Pow(10, -12);
      c[6] = 4.1635019;
    }
    else{
      c[0] = -5800.2206;
      c[1] = 1.3914993;
      c[2] = -0.048640239;
      c[3] = 0.41764768 * Math.Pow(10, -4);
      c[4] = -0.14452093 * Math.Pow(10, -7);
      c[5] = 0;
      c[6] = 6.5459673;
    }

    for(var i = 0;i < 6;i++){
      pascals += c[i] * Math.Pow(kelvin, i - 1);
    }
    pascals += c[6] * Math.Log(kelvin);
    pascals = Math.Exp(pascals);
    return pascals;
  }
# ---------- end c_script ----------
path = DataPath(number_slider)
boundary = BoundarySurfaces(Edges=item_2)
branch = TreeBranch(Tree=c_script.A, Path=path, MaintainPaths=True)
tag = TextTag3D(Location=area.Centroid, Text=item, Size=number_slider_2, Justification=7)
pdecon = Deconstruct(Point=c_script.A)  # -> XComponent, YComponent, ZComponent
pline = PolyLine(Vertices=branch, Closed=False)
tag_2 = TextTag3D(Location=cp.Points, Text=pdecon.YComponent, Size=number_slider_2, Justification=7)
